# Grasshopper definition MatPlotLib_Timo_001.gh (Grasshopper 1.0.7)
# plug-ins: Hops, AviaryHoopoeGH, AviaryMacawGH, Bifocals, MeshEdit Components

number_slider = Slider(1330, range=0..1330)

number_slider_2 = Slider(100, range=0..100)
negative = Negative(Value=number_slider)
panel = Panel("-12")
panel_2 = Panel("12")
construct_domain = ConstructDomain(DomainStart=negative, DomainEnd=number_slider)

number_slider_3 = Slider(1000, range=0..1000)
range = Range(Domain=Domain(0, 1), Steps=10)
# MatPlotLib
# for Timo
# call these functions with Hops:
# linear_regression
# linear_regression_plot
# plot_scatter1
# plot_graph
# plot_bar
# plot_pie
# plot_donut
# plot_scatter_3d
range_2 = Range(Domain=Domain(0, 1), Steps=10)
number_slider_4 = Slider(12, range=0..100)
number_slider_5 = Slider(12, range=0..100)
file_path = FilePath("C:\Users\Sculpture\Desktop\MatPoltLib_saves\Figure_1.png")
drawing_to_bitmap = DrawingToBitmap(PPI=96)
export_svg = ExportSVG(Save=False)
export_bitmap = ExportBitmap(DPI=96, Extention=0, Save=False)
linear_regression_plot = Hops(
    XList=range_2,
    YList=range,
    CacheResultsInMemory=False,
    CacheSolveResults=False,
    RemoteDefinitionLocation="http://127.0.0.1:5000/linear_regression_plot",
    RemoteSolveVersion=(0, 1, 0),
    ShowInput_Enabled=False,
    ShowInput_Path=False,
    SynchronousSolve=True)
linear_regression = Hops(
    XList=range_2,
    YList=range,
    CacheResultsInMemory=True,
    CacheSolveResults=True,
    RemoteDefinitionLocation="http://127.0.0.1:5000/linear_regression",
    RemoteSolveVersion=(0, 1, 0),
    ShowInput_Enabled=False,
    ShowInput_Path=False,
    SynchronousSolve=True)
import_image = ImportImage(File=file_path)
panel_3 = Panel(linear_regression)
panel_4 = Panel(linear_regression_plot)
rectangle = Rectangle(Plane=PlaneXY(0, 0, 0), XSize=number_slider, YSize=number_slider_3, Radius=0)  # -> Rectangle, Length
bounding_box = BoundingBox(Content=import_image, Plane=PlaneXY(0, 0, 0))  # -> Box, Box_2
deconstruct_brep = DeconstructBrep(Brep=bounding_box.Box)  # -> Faces, Edges, Vertices
dimensions = Dimensions(Surface=deconstruct_brep.Faces)  # -> UDimension, VDimension
number_slider_6 = Slider(100, range=0..100)
division = Division(A=dimensions.UDimension, B=dimensions.VDimension)
multiplication = Multiplication(A=division, B=number_slider_6)
number_slider_7 = Slider(10, range=0..10)
integer = Integer(multiplication)
one_over_x = OneOverX(Value=integer)
one_over_x_2 = OneOverX(Value=integer)
rectangular = Rectangular(Plane=PlaneXY(0, 0, 0), SizeX=one_over_x, SizeY=one_over_x_2, ExtentX=integer, ExtentY=number_slider_6)  # -> Cells, Points
rectangular_2 = Rectangular(Plane=PlaneXY(0, 0, 0), SizeX=number_slider_7, SizeY=number_slider_7, ExtentX=integer, ExtentY=number_slider_6)  # -> Cells, Points
deconstruct = Deconstruct(Point=rectangular.Points)  # -> XComponent, YComponent, ZComponent
image_sampler = ImageSampler(
    rectangular.Points,
    FilePath="C:\Users\Sculpture\Desktop\MatPoltLib_saves\Figure_1.png",
    Filter="Value",
    Interpolate=True,
    Umax=1,
    Umin=0,
    Vmax=1,
    Vmin=0,
    Wrap=1)
bounds = Bounds(Numbers=flatten(deconstruct.XComponent))
multiplication_2 = Multiplication(A=image_sampler, B=Slider(-3.93, range=-20..0))
panel_6 = Panel(image_sampler)
panel_7 = Panel(bounds)
unit_z = UnitZ(Factor=multiplication_2)
move = Move(Geometry=rectangular_2.Points, Motion=unit_z)  # -> Geometry, Transform
circle = Circle(Plane=rectangular_2.Points, Radius=multiplication_2)
curve_to_shape = CurveToShape(Curve=flatten(circle))
compose_drawing = ComposeDrawing(
    Shapes=curve_to_shape,
    Boundary=rectangle.Rectangle,
    Width=number_slider,
    Height=number_slider_3,
    Backround=RGBA(255, 255, 255, 0))
drawing_to_bitmap_2 = DrawingToBitmap(Drawing=compose_drawing, PPI="96")
export_bitmap_2 = ExportBitmap(Image=drawing_to_bitmap_2, Extention=0, Save=False)
export_svg_2 = ExportSVG(Drawing=compose_drawing, Save=Toggle(False))
panel_8 = Panel(export_svg_2)
panel_9 = Panel(export_bitmap_2)
view_drawing = ViewDrawing(Drawing=compose_drawing)
surface_from_points = SurfaceFromPoints(Points=flatten(move.Geometry), UCount=expr("x+1", integer), Interpolate=False)

mesh_frompoints = MeshFromPoints(Points=flatten(move.Geometry), UDirection=expr("x+1", integer), VDirection=expr("x+1", number_slider_6))

geometry = Geometry(surface_from_points)
mesh_to_shape = MeshToShape(Mesh=mesh_frompoints)
brep_to_shape = BrepToShape(Brep=geometry)
